# Grasshopper definition example.gh (Grasshopper 1.0.7)
# plug-ins: baues-toolbox Info, THERB-GH

# step0.ジオメトリの前処理を行う
brep = Brep([<brep referenced from the Rhino model> x20])
split_geometries = SplitGeos(Geometries=brep, Tolerance=Slider(0.1, range=0.1..10))  # -> Splitted, Errors
digit_scroller = DigitScroller(Scroller_Digits=12, Scroller_Prefix="Index", Scroller_Radix=11, Scroller_Value=13)
srf = Surface(split_geometries.Errors)
box = Box({Plane=PlaneXY(41.37666819, 10.43952063, 0), X=Domain(0, 16.74319471), Y=Domain(0, 9.045752188), Z=Domain(0, 9.187566884)})
debrep = DeconstructBrep(Brep=box)  # -> Faces, Edges, Vertices
digit_scroller_2 = DigitScroller(Scroller_Digits=12, Scroller_Prefix="Index", Scroller_Radix=11, Scroller_Value=12)
cull_i = CullIndex(List=debrep.Faces, Indices=0, Wrap=True)

# ----
# 北の方角を指定
number_slider = Slider(0.1, range=0..0.1)
windows_split = Surface([<surface referenced from the Rhino model> x3])
# step1. ジオメトリ、条件入力
rooms_split = Brep([<brep referenced from the Rhino model> x20])

python = GhPythonScript(x=cull_i)  # -> out, flatten(a); inputs x: list of Brep
# ---------- python: Python ----------
from Rhino.Geometry import Brep

a = Brep.JoinBreps(x, 0.1)
# ---------- end python ----------
vec = Vector()
brep_2 = Brep([<brep referenced from the Rhino model> x3])
readproperty = ReadProperty()
brep_3 = Brep([<brep referenced from the Rhino model> x2])
therb = THERB(Geometries=python.a, Tolerance=0.1)  # -> Therb, Test; disabled
brep_4 = Brep([<brep referenced from the Rhino model> x2])
brep_5 = Brep(brep_4)
c_script = CSharpScript(geometries=brep_5)  # -> out, A; inputs geometries: list of Brep
# ---------- c_script: C# usings ----------
using System.Linq;
# ---------- c_script: C# ----------
    double tol = 10;
    List<Brep> splitGeos;
    try
    {
      splitGeos = SplitGeometry(geometries, tol);
    }
    catch(Exception e)
    {
      Component.AddRuntimeMessage(GH_RuntimeMessageLevel.Error, e.Message);
      return;
    }
    A = splitGeos;
# ---------- c_script: C# additional code ----------
  private List<Brep> SplitGeometry(List<Brep> breps, double tol)
  {
    if (breps.Count == 1)
    {
      if (!breps[0].IsSolid) throw new Exception();
      return breps;
    }
    List<Brep> splitGeos = new List<Brep>();
    for (int i = 0; i < breps.Count; i = i + 1)
    {
      if (!breps[i].IsSolid) throw new Exception("開かれたBrepが入れられました");

      List<Brep> cutterBreps = breps.FindAll(geo => geo != breps[i]);
      Brep[] splitGeo = breps[i].Split(cutterBreps, tol);
      Brep jointedBrep = Brep.JoinBreps(splitGeo, tol)[0];

      if (!jointedBrep.IsSolid) throw new Exception("BrepのJointが失敗しました。");

      splitGeos.Add(jointedBrep);
    }
    return splitGeos;
  }
# ---------- end c_script ----------
brep_6 = Brep(brep_5)
split = SplitBrep(Brep=brep_6, Cutter=graft(brep_6))
c_script_2 = CSharpScript(x=brep_6)  # -> out, A; inputs x: list of Brep
# ---------- c_script_2: C# ----------
    List<Brep> results = new List<Brep>();
    foreach(Brep item in x){
      List<Brep> cutter = x.FindAll(geo => geo != item);
      Brep[] result = item.Split(cutter, 0.1);
      results.AddRange(result.ToList());
    }

    A = results;
# ---------- end c_script_2 ----------
bang = ExplodeTree(Data=split)  # -> Branch0, Branch1, Branch2, Branch3
panel = Panel(split)
panel_2 = Panel(box)
therb_2 = THERB(Geometries=box, Tolerance=0.1)  # -> Therb, Test; disabled
brep_7 = Brep([<brep referenced from the Rhino model> x2])
brep_8 = Brep(brep_7)
c_script_3 = CSharpScript(geometries=brep_8)  # -> out, A; inputs geometries: list of Brep
# ---------- c_script_3: C# usings ----------
using System.Linq;
using Rhino.Geometry.Collections;
# ---------- c_script_3: C# ----------
    double tol = 0.1;
    List<Brep> splitGeos;
    try
    {
      splitGeos = SplitGeometry(geometries, tol);
      //splitGeos = SplitGeometry2(geometries, tol);
    }
    catch(Exception e)
    {
      Component.AddRuntimeMessage(GH_RuntimeMessageLevel.Error, e.Message);
      return;
    }
    List<Surface> resultSrf = new List<Surface>();
    //List<Brep> resultSrf = new List<Brep>();
    foreach (Brep geo in splitGeos)
    {

      //BrepFaceList srfs = geo.Faces;
      foreach (var brepface in geo.Faces)
      {

        //resultSrf.Add(brepface.Brep);
        resultSrf.Add(Brep.CreateEdgeSurface(brepface.ToBrep().Edges).Faces[0].ToNurbsSurface());
        //Print("" + brepface.IsSurface);
        //Print("" + brepface.Brep.IsSurface);
        //Print("" + brepface.Brep.Edges.Count);
        Print("" + brepface.ToBrep().Edges.Count);

        //BrepEdgeList edges;
        /*
        if(2 < brepface.Brep.Edges.Count & brepface.Brep.Edges.Count < 5){
        edges = brepface.Brep.Edges;
        }
        else{
        edges = brepface.ToBrep().Edges;
        }*//*
        Surface srf;
        if(brepface.IsSurface){
        srf = brepface.ToNurbsSurface();
        }
        else{
        edges = brepface.Brep.Edges;
        Print("" + edges.Count);
        if(edges.Count < 2 | 4 < edges.Count) {
        A = resultSrf;
        return; //throw new Exception("Edgeの分割に失敗しました。");
        }
        srf = Brep.CreateEdgeSurface(edges).Faces[0].ToNurbsSurface();
        }

        resultSrf.Add(srf);*/

      }
    }
    A = resultSrf;
# ---------- c_script_3: C# additional code ----------
  private List<Brep> SplitGeometry(List<Brep> breps, double tol)
  {
    if (breps.Count == 1)
    {
      if (!breps[0].IsSolid) throw new Exception();
      return breps;
    }
    List<Brep> splitGeos = new List<Brep>();
    for (int i = 0; i < breps.Count; i = i + 1)
    {
      if (!breps[i].IsSolid) throw new Exception("開かれたBrepが入れられました");

      List<Brep> cutterBreps = breps.FindAll(geo => geo != breps[i]);
      Brep[] splitGeo = breps[i].Split(cutterBreps, tol);
      Brep jointedBrep = Brep.JoinBreps(splitGeo, tol)[0];

      if (!jointedBrep.IsSolid) throw new Exception("BrepのJointが失敗しました。");

      splitGeos.Add(jointedBrep);
    }
    return splitGeos;
  }

  private List<Brep> SplitGeometry2(List<Brep> breps, double tol)
  {
    if (breps.Count == 1)
    {
      if (!breps[0].IsSolid) throw new Exception();
      return breps;
    }
    List<Brep> splitGeos = new List<Brep>();
    for (int i = 0; i < breps.Count; i = i + 1)
    {
      if (!breps[i].IsSolid) throw new Exception("開かれたBrepが入れられました");

      List<Brep> cutterBreps = breps.FindAll(geo => geo != breps[i]);
      Brep[] splitGeo = breps[i].Split(cutterBreps, tol);/*
      Brep jointedBrep = Brep.JoinBreps(splitGeo, tol)[0];

      if (!jointedBrep.IsSolid) throw new Exception("BrepのJointが失敗しました。");*/

      splitGeos.AddRange(splitGeo.ToList());
    }
    return splitGeos;
  }
# ---------- end c_script_3 ----------
c_script_4 = CSharpScript(geometries=brep_8)  # -> out, A; inputs geometries: list of Brep
# ---------- c_script_4: C# ----------
    double tol = 0.1;
    List<Brep> splitGeos;
    try
    {
      splitGeos = SplitGeometry(geometries, tol);
      //splitGeos = SplitGeometry2(geometries, tol);
    }
    catch(Exception e)
    {
      Component.AddRuntimeMessage(GH_RuntimeMessageLevel.Error, e.Message);
      return;
    }
    List<Surface> resultSrf = new List<Surface>();
    //List<Brep> resultSrf = new List<Brep>();
    foreach (Brep geo in splitGeos)
    {

      //BrepFaceList srfs = geo.Faces;
      foreach (var brepface in geo.Faces)
      {

        //resultSrf.Add(brepface.Brep);
        Print("" + brepface.IsSurface);
        if(brepface.IsSurface){
          resultSrf.Add(brepface);
        }
        else{
          BrepEdgeList edges = brepface.Brep.Edges;/*
          Print("" + edges.Count);
          Print("" + brepface.Brep.Edges.Count);
          Print("" + brepface.ToBrep().Edges.Count);*/
          if(edges.Count < 2 | 4 < edges.Count) {
            A = resultSrf;
            return; //throw new Exception("Edgeの分割に失敗しました。");
          }
          Surface srf = Brep.CreateEdgeSurface(edges).Faces[0].ToNurbsSurface();
          resultSrf.Add(srf);
        }
        //Print("" + brepface.Brep.IsSurface);
        //Print("" + brepface.Brep.Edges.Count);
        //Print("" + brepface.ToBrep().Edges.Count);
        /*
        BrepEdgeList edges;
        if(2 < brepface.Brep.Edges.Count & brepface.Brep.Edges.Count < 5){
        edges = brepface.Brep.Edges;
        }
        else{
        edges = brepface.ToBrep().Edges;
        }
        Surface srf;
        if(brepface.IsSurface){
        srf = brepface.ToNurbsSurface();
        }
        else{
        edges = brepface.Brep.Edges;
        Print("" + edges.Count);
        if(edges.Count < 2 | 4 < edges.Count) {
        A = resultSrf;
        return; //throw new Exception("Edgeの分割に失敗しました。");
        }
        srf = Brep.CreateEdgeSurface(edges).Faces[0].ToNurbsSurface();
        }

        resultSrf.Add(srf);*/

      }
    }
    A = resultSrf;
# ---------- c_script_4: C# additional code ----------
  private List<Brep> SplitGeometry(List<Brep> breps, double tol)
  {
    if (breps.Count == 1)
    {
      if (!breps[0].IsSolid) throw new Exception();
      return breps;
    }
    List<Brep> splitGeos = new List<Brep>();
    for (int i = 0; i < breps.Count; i = i + 1)
    {
      if (!breps[i].IsSolid) throw new Exception("開かれたBrepが入れられました");

      List<Brep> cutterBreps = breps.FindAll(geo => geo != breps[i]);
      Brep[] splitGeo = breps[i].Split(cutterBreps, tol);
      Brep jointedBrep = Brep.JoinBreps(splitGeo, tol)[0];

      if (!jointedBrep.IsSolid) throw new Exception("BrepのJointが失敗しました。");

      splitGeos.Add(jointedBrep);
    }
    return splitGeos;
  }

  private List<Brep> SplitGeometry2(List<Brep> breps, double tol)
  {
    if (breps.Count == 1)
    {
      if (!breps[0].IsSolid) throw new Exception();
      return breps;
    }
    List<Brep> splitGeos = new List<Brep>();
    for (int i = 0; i < breps.Count; i = i + 1)
    {
      if (!breps[i].IsSolid) throw new Exception("開かれたBrepが入れられました");

      List<Brep> cutterBreps = breps.FindAll(geo => geo != breps[i]);
      Brep[] splitGeo = breps[i].Split(cutterBreps, tol);/*
      Brep jointedBrep = Brep.JoinBreps(splitGeo, tol)[0];

      if (!jointedBrep.IsSolid) throw new Exception("BrepのJointが失敗しました。");*/

      splitGeos.AddRange(splitGeo.ToList());
    }
    return splitGeos;
  }
# ---------- end c_script_4 ----------
c_script_5 = CSharpScript(geometries=brep_8)  # -> out, A; inputs geometries: list of Brep
# ---------- c_script_5: C# ----------
    double tol = 0.1;
    List<Brep> splitGeos;
    try
    {
      splitGeos = SplitGeometry(geometries, tol);
      //splitGeos = SplitGeometry2(geometries, tol);
    }
    catch(Exception e)
    {
      Component.AddRuntimeMessage(GH_RuntimeMessageLevel.Error, e.Message);
      return;
    }
    List<Surface> resultSrf = new List<Surface>();
    //List<Brep> resultSrf = new List<Brep>();
    A = splitGeos;
# ---------- c_script_5: C# additional code ----------
  private List<Brep> SplitGeometry(List<Brep> breps, double tol)
  {
    if (breps.Count == 1)
    {
      if (!breps[0].IsSolid) throw new Exception();
      return breps;
    }
    List<Brep> splitGeos = new List<Brep>();
    for (int i = 0; i < breps.Count; i = i + 1)
    {
      if (!breps[i].IsSolid) throw new Exception("開かれたBrepが入れられました");

      List<Brep> cutterBreps = breps.FindAll(geo => geo != breps[i]);
      Brep[] splitGeo = breps[i].Split(cutterBreps, tol);
      Brep jointedBrep = Brep.JoinBreps(splitGeo, tol)[0];

      if (!jointedBrep.IsSolid) throw new Exception("BrepのJointが失敗しました。");

      splitGeos.Add(jointedBrep);
    }
    return splitGeos;
  }

  private List<Brep> SplitGeometry2(List<Brep> breps, double tol)
  {
    if (breps.Count == 1)
    {
      if (!breps[0].IsSolid) throw new Exception();
      return breps;
    }
    List<Brep> splitGeos = new List<Brep>();
    for (int i = 0; i < breps.Count; i = i + 1)
    {
      if (!breps[i].IsSolid) throw new Exception("開かれたBrepが入れられました");

      List<Brep> cutterBreps = breps.FindAll(geo => geo != breps[i]);
      Brep[] splitGeo = breps[i].Split(cutterBreps, tol);/*
      Brep jointedBrep = Brep.JoinBreps(splitGeo, tol)[0];

      if (!jointedBrep.IsSolid) throw new Exception("BrepのJointが失敗しました。");*/

      splitGeos.AddRange(splitGeo.ToList());
    }
    return splitGeos;
  }
# ---------- end c_script_5 ----------
brep_9 = Brep(c_script_3.A)
panel_3 = Panel(brep_9)
item = ListItem(List=brep_9, Index=digit_scroller, Wrap=True)
python_2 = GhPythonScript(x=item)  # -> out, a; inputs x: Brep
# ---------- python_2: Python ----------
from Rhino.Geometry import Brep

edges = x.Edges

a = Brep.CreateEdgeSurface(edges)
# ---------- end python_2 ----------
panel_4 = Panel(c_script_3.out)
brep_10 = Brep(brep_7)
brep_11 = Brep(brep_7)
c_script_6 = CSharpScript(geometries=brep_10)  # -> out, A; inputs geometries: list of Brep
# ---------- c_script_6: C# ----------
    double tol = 0.1;
    List<Brep> splitGeos;
    try
    {
      splitGeos = SplitGeometry(geometries, tol);
    }
    catch
    {
      Component.AddRuntimeMessage(GH_RuntimeMessageLevel.Error, "開かれたBrepが入れられました。");
      return;
    }
    A = splitGeos;
# ---------- c_script_6: C# additional code ----------
  private List<Brep> SplitGeometry(List<Brep> breps, double tol)
  {
    if (breps.Count == 1)
    {
      if (!breps[0].IsSolid) throw new Exception();
      return breps;
    }
    List<Brep> splitGeos = new List<Brep>();
    for (int i = 0; i < breps.Count; i = i + 1)
    {
      if (!breps[i].IsSolid) throw new Exception();

      List<Brep> cutterBreps = breps.FindAll(geo => geo != breps[i]);
      Brep[] splitGeo = breps[i].Split(cutterBreps, tol);
      Brep jointedBrep = Brep.JoinBreps(splitGeo, tol)[0];

      if (!jointedBrep.IsSolid) throw new Exception();

      splitGeos.Add(jointedBrep);
    }
    return splitGeos;
  }
# ---------- end c_script_6 ----------
c_script_7 = CSharpScript(splitGeos=c_script_6.A)  # -> out, A; inputs splitGeos: list of Brep
# ---------- c_script_7: C# usings ----------
using Rhino.Geometry.Collections;
# ---------- c_script_7: C# ----------
    //double tol = 0.1;
    //Roomに対する処理
    List<Surface> sl = new List<Surface>();

    foreach (Brep geo in splitGeos)
    {
      BrepFaceList srfs = geo.Faces;
      foreach (BrepFace brepface in srfs)
      {
        Surface srf = brepface;
        //Vector3d normal = srf.NormalAt(0.5, 0.5);
        //Vector3d tempNormal = reviseNormal(srf, temp);
        sl.Add(srf);
      }
    }
    A = sl;
# ---------- end c_script_7 ----------
debrep_2 = DeconstructBrep(Brep=c_script_6.A)  # -> Faces, Edges, Vertices
item_2 = ListItem(List=flatten(debrep_2.Faces), Index=digit_scroller_2, Wrap=True)  # -> Item, Item1
panel_5 = Panel(python.a)
entwine = Entwine(Branch00=bang.Branch1, Branch01=bang.Branch2, FlattenInputs=True)
unflatten = UnflattenTree(Tree=c_script_2.A, Guide=entwine)
srf_2 = Surface(<surface referenced from the Rhino model>)
srf_3 = Surface(<surface referenced from the Rhino model>)
srf_4 = Surface([item_2.Item, item_2.Item1])
rec = Rectangle(srf_4)
number_slider_2 = Slider(2, range=0..100)
panel_6 = Panel([item_2.Item, item_2.Item1])
digit_scroller_3 = DigitScroller(Scroller_Digits=12, Scroller_Prefix="Path", Scroller_Radix=11, Scroller_Value=5)
join = BrepJoin(Breps=entwine)  # -> Breps, Closed
c_script_8 = CSharpScript(x=unflatten)  # -> out, A; inputs x: list of Brep
# ---------- c_script_8: C# ----------
    A = Brep.JoinBreps(x, 0.1);
# ---------- end c_script_8 ----------
therb_3 = THERB(Geometries=rooms_split, Windows=windows_split, Tolerance=number_slider)  # -> Therb, Test
# タスク13.fiterFaceByPropertyを実装
filterfacebyproperty = FilterFaceByProperty(Therb=therb_3.Therb, ElementType="interiorwall")  # -> TrueFace, FalseFace
readproperty_2 = ReadProperty(Faces=filterfacebyproperty.TrueFace)  # -> PartId, Surface, ElementType, Normal, Direction, AdjacencyRoomId
c_script_9 = CSharpScript(geometries=brep_6)  # -> out, A, B; inputs geometries: list of Brep
# ---------- c_script_9: C# ----------
    double tol = 0.1;
    List<Brep> splitGeos;
    try
    {
      splitGeos = SplitGeometry(geometries, tol);
    }
    catch(Exception e)
    {
      Component.AddRuntimeMessage(GH_RuntimeMessageLevel.Error, e.Message);
      return;
    }

    //DataTree<Curve> results = new DataTree<Curve>();
    DataTree<Surface> results = new DataTree<Surface>();
    foreach (Brep geo in splitGeos)
    {

      var srfs = geo.Faces;
      foreach (var brepface in srfs)
      {
        Print("" + brepface.DuplicateFace(false).IsSurface);
        Brep brep = brepface.DuplicateFace(false);
        Surface srf;
        if(brepface.DuplicateFace(false).IsSurface){
          srf = brepface;
        }
        else{
          var edges = brepface.DuplicateFace(false).Edges;
          //edges = eqalEdge(edges, tol);
          if(edges.Count < 2 | 4 < edges.Count) {
            Print("" + edges.Count);
            foreach(var edge in edges){
              Print("S: " + edge.PointAtStart);
              Print("E: " + edge.PointAtEnd);
            }
            A = results;
            B = Curve.JoinCurves(edges)[0].DuplicateSegments();
            return;// throw new Exception("Edgeの分割に失敗しました。");
          }
          srf = Brep.CreateEdgeSurface(edges).Faces[0].ToNurbsSurface();
        }
        results.Add(srf);
      }
    }

    A = results;
# ---------- c_script_9: C# additional code ----------
  private List<Brep> SplitGeometry(List<Brep> breps, double tol)
  {
    if (breps.Count == 1)
    {
      if (!breps[0].IsSolid) throw new Exception();
      return breps;
    }
    List<Brep> splitGeos = new List<Brep>();
    for (int i = 0; i < breps.Count; i = i + 1)
    {
      if (!breps[i].IsSolid) throw new Exception("開かれたBrepが入れられました");

      List<Brep> cutterBreps = breps.FindAll(geo => geo != breps[i]);
      Brep[] splitGeo = breps[i].Split(cutterBreps, tol);
      Brep jointedBrep = Brep.JoinBreps(splitGeo, tol)[0];

      if (!jointedBrep.IsSolid) throw new Exception("BrepのJointが失敗しました。");

      splitGeos.Add(jointedBrep);
    }
    return splitGeos;
  }

  /*
  private List<Curve> eqalEdge(List<Curve> edges, double tol){
    List<Curve> result = new List<Curve>();
    foreach(edge in
  }
 */
# ---------- end c_script_9 ----------
srf_5 = Surface(readproperty_2.Surface)
debrep_3 = DeconstructBrep(Brep=join.Breps)  # -> flatten(Faces), Edges, Vertices
c_script_10 = CSharpScript(x=c_script_8.A)  # -> out, flatten(A); inputs x: list of Brep
# ---------- c_script_10: C# ----------
    List<Surface> results = new List<Surface>();
    foreach(Brep item in x){
      foreach(BrepFace itemitem in item.Faces){
        results.Add((Surface) itemitem);
      }
    }
    A = results;
# ---------- end c_script_10 ----------
panel_7 = Panel(join.Breps)
panel_8 = Panel(c_script_9.A)
digit_scroller_4 = DigitScroller(Scroller_Digits=12, Scroller_Prefix="Index", Scroller_Radix=11, Scroller_Value=13)
python_3 = GhPythonScript(x=brep_7, y=srf_3)  # -> out, a; inputs x: list
# ---------- python_3: Python ----------
a = [x, y]
# ---------- end python_3 ----------
digit_scroller_5 = DigitScroller(Scroller_Digits=12, Scroller_Prefix="Index", Scroller_Radix=11, Scroller_Value=12)
debrep_4 = DeconstructBrep(Brep=debrep_3.Faces)  # -> flatten(Faces), Edges, Vertices
item_3 = ListItem(List=readproperty_2.Surface, Index=number_slider_2, Wrap=True)
item_4 = ListItem(List=readproperty_2.PartId, Index=number_slider_2, Wrap=True)
exportb = ExportB(Therb=therb_3.Therb)
exporta = ExportA(Therb=therb_3.Therb)
exportr = ExportR(Therb=therb_3.Therb)
python_4 = GhPythonScript(x=c_script_10.A)  # -> out, a; inputs x: Surface
# ---------- python_4: Python ----------
print(type(x))
# ---------- end python_4 ----------
c_script_11 = CSharpScript(x=c_script_10.A)  # -> out, A; inputs x: list of Brep
# ---------- c_script_11: C# ----------
    DataTree<Curve> results = new DataTree<Curve>();
    for(int index = 0;index < x.Count; index++){
      foreach(BrepEdge itemEdge in x[index].Edges){
        results.Add((Curve) itemEdge, new GH_Path(index));
      }
    }
    A = results;
# ---------- end c_script_11 ----------
panel_9 = Panel(c_script_9.out)
branch = TreeBranch(Tree=simplify(debrep_4.Edges), Path=digit_scroller_3, MaintainPaths=True)
therb_4 = THERB(BDat=exportb, RDat=exportr, Name="TEST", Run=Toggle(False))
item_5 = ListItem(Index=digit_scroller_4, Wrap=True)
branch_2 = TreeBranch(Tree=simplify(c_script_11.A), Path=digit_scroller_3, MaintainPaths=True)
item_6 = ListItem(List=c_script_9.A, Index=digit_scroller_5, Wrap=True)
crv = Curve(c_script_9.B)

# ----
# step2. 出力をチェック
b_datファイル書き出し = Panel(exportb)
r_datファイル書き出し = Panel(exportr)
a_datファイル書き出し = Panel(exporta)

# ----
# step03.
# サーバーにuploadする
# ための情報を入力
# step03-1. サーバーのドメイン入力
# (今のところ、ここは変える必要ないです）
# step03-2. プロジェクト名を入力
# step03-3. Trueにするとuploadして計算開始
panel_10 = Panel("http://localhost:5000/run")

uploadtherb = UploadTherb(Url=panel_10, ProjectName="demo2", Upload=Toggle(True))
# step04.
# サーバーからのresponseが表示されます。
# successとなっていれば、以下のurlをchrome
# で表示してください
# step05.
# 計算結果をPythonを利用してさらに分析することができます。
# 以下に分析例をまとめたJupyter Notebookを置いています。
# https://github.com/becat-oss/therb-notebook
panel_11 = Panel(uploadtherb)
