# Grasshopper definition example_完成イメージ.gh (Grasshopper 1.0.7)
# plug-ins: baues-toolbox Info, THERB-GH

windows_split = Surface([<surface referenced from the Rhino model> x3])
# step1. ジオメトリ、条件入力
rooms_split = Brep([<brep referenced from the Rhino model> x20])

brep = Brep([<brep referenced from the Rhino model> x3])
box = Box({Plane=PlaneXY(41.37666819, 10.43952063, 0), X=Domain(0, 16.74319471), Y=Domain(0, 9.045752188), Z=Domain(0, 9.187566884)})
brep_2 = Brep([<brep referenced from the Rhino model> x2])
debrep = DeconstructBrep(Brep=box)  # -> Faces, Edges, Vertices
srf = Surface(<surface referenced from the Rhino model>)
srf_2 = Surface(<surface referenced from the Rhino model>)
cull_i = CullIndex(List=debrep.Faces, Indices=0, Wrap=True)
item = ListItem(List=brep_2, Index=0, Wrap=True)
python = GhPythonScript(x=cull_i)  # -> out, flatten(a); inputs x: list of Brep
# ---------- python: Python ----------
from Rhino.Geometry import Brep

a = Brep.JoinBreps(x, 0.1)
# ---------- end python ----------
therb = THERB(Geometries=brep_2, Windows=srf_2, Overhangs=srf, Tolerance=Slider(0.1, range=0..0.1))  # -> Therb, Test
therb_2 = THERB(Geometries=brep_2, Tolerance=0.1)  # -> Therb, Test
readproperty = ReadProperty()
panel = Panel(python.a)
therb_3 = THERB(Geometries=python.a, Tolerance=0.1)  # -> Therb, Test
panel_2 = Panel(box)
therb_4 = THERB(Geometries=box, Tolerance=0.1)  # -> Therb, Test
python_2 = GhPythonScript(x=brep_2, y=srf_2)  # -> out, a; inputs x: list
# ---------- python_2: Python ----------
a = [x, y]
# ---------- end python_2 ----------
readproperty_2 = ReadProperty(Therb=therb_2.Therb)
exportb = ExportB(Therb=therb.Therb)
exportr = ExportR(Therb=therb.Therb)

# ----
# step2. 出力をチェック
b_datファイル書き出し = Panel(exportb)
r_datファイル書き出し = Panel(exportr)

# ----
# step03.
# サーバーにuploadする
# ための情報を入力
# step03-1. サーバーのドメイン入力
# (今のところ、ここは変える必要ないです）
# step03-2. プロジェクト名を入力
# step03-3. Trueにするとuploadして計算開始
panel_3 = Panel("http://localhost:5000/run")

uploadtherb = UploadTherb(Url=panel_3, ProjectName="demo2", Upload=Toggle(True))
# step04.
# サーバーからのresponseが表示されます。
# successとなっていれば、以下のurlをchrome
# で表示してください
# step05.
# 計算結果をPythonを利用してさらに分析することができます。
# 以下に分析例をまとめたJupyter Notebookを置いています。
# https://github.com/becat-oss/therb-notebook
panel_4 = Panel(uploadtherb)
